# Grasshopper definition shoe_box_energy_model.gh (Grasshopper 1.0.7)

# ---- group: Dynamically Chage Glazing Ratio
number_slider = Slider(0.4, range=-0.1..0.9)

# ----
# Request Outputs
toggle = BooleanToggle(True)
simoutput = HBSimulationOutput(zone_energy_use=toggle, hvac_energy_use=toggle, gains_and_losses=toggle)  # -> report, sim_output; plug-in component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
simpar = HBSimulationParameter(output=simoutput.sim_output, timestep=6)  # -> sim_par; plug-in component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

# ----
# Download EPW File
panel = Panel("https://www.energyplus.net/weather-download/north_and_central_america_wmo_region_4/USA/MA/USA_MA_Boston-Logan.Intl.AP.725090_TMY3/all")
downloadepw = LBDownloadWeather(weather_URL=panel)  # -> epw_file, stat_file, ddy_file; plug-in component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

toggle_2 = BooleanToggle(False)

# ----
# Create Honeybee Model
panel_2 = Panel("outdoors")
geo = Geometry([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])
geo_2 = Geometry(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)
face = HBFace(geo=geo, bc=panel_2)  # -> report, faces; plug-in component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
face_2 = HBFace(geo=geo_2, bc="adiabatic")  # -> report, faces; plug-in component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
aperturesbyratio = HBAperturesByRatio(hb_objs=flatten(face.faces), ratio=number_slider)  # -> report, hb_objs; plug-in component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
all_air = HBAllAirHVACTemplates({"VAV chiller with gas boiler reheat": "VAV_Chiller_Boiler", "VAV chiller with central air source heat pump reheat": "VAV_Chiller_ASHP", "VAV chiller with district hot water reheat": "VAV_Chiller_DHW", "VAV chiller with PFP boxes": "VAV_Chiller_PFP", "VAV chiller with gas coil reheat": "VAV_Chiller_GasCoil", "VAV air-cooled chiller with gas boiler reheat": "VAV_ACChiller_Boiler", "VAV air-cooled chiller with central air source heat pump reheat": "VAV_ACChiller_ASHP", "VAV air-cooled chiller with district hot water reheat": "VAV_ACChiller_DHW", "VAV air-cooled chiller with PFP boxes": "VAV_ACChiller_PFP", "VAV air-cooled chiller with gas coil reheat": "VAV_ACChiller_GasCoil"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}, selected="VAV chiller with gas boiler reheat")
room = HBRoom(
    faces=flatten([face_2.faces, aperturesbyratio.hb_objs]),
    name="Office Shoe Box",
    constr_set="2013::ClimateZone5::SteelFramed",
    program="2013::LargeOffice::OpenOffice",
    conditioned=True)  # -> report, room; plug-in component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
concat = Concatenate(FragmentA="ShoeBox", FragmentB=number_slider)
allairhvac = HBAllAirHVAC(rooms=flatten(room.room), system_type=all_air, name="VAV System", economizer="DifferentialDryBulb")  # -> report, rooms; plug-in component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

daylightcontrol = HBApplyDaylightControl(rooms=flatten(allairhvac.rooms))  # -> report, rooms; plug-in component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

model = HBModel(rooms=flatten(daylightcontrol.rooms), name=concat)  # -> report, model; plug-in component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

vizbytype = HBVisualizeByType(hb_objs=model.model)  # -> walls, interior_walls, roofs, ceilings, exterior_floors, interior_floors, air_walls, apertures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; plug-in component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
modeltoosm = HBModelToOSM(model=model.model, epw_file=downloadepw.epw_file, sim_par=simpar, write=toggle_2, run=toggle_2)  # -> report, jsons, osw, osm, idf, sql, zsz, rdd, html; plug-in component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

# ----
# Compute EUI
eui = HBEndUseIntensity(sql=modeltoosm.sql)  # -> eui, eui_end_use, end_uses, gross_floor; plug-in component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
eui_kwh_m2 = Panel(eui.eui)
panel_3 = Panel(eui.eui_end_use)
panel_4 = Panel(eui.end_uses)

# ----
# Visualize Results
roomenergyresult = HBReadRoomEnergyResult(sql=modeltoosm.sql)  # -> cooling, heating, lighting, electric_equip, gas_equip, hot_water, fan_electric, pump_electric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; plug-in component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
hourlyplot = LBHourlyPlot(data=[roomenergyresult.cooling, roomenergyresult.heating])  # -> report, mesh, legend, borders, labels, title; plug-in component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
